# Grasshopper definition TimberAssembly_WallSample.gh (Grasshopper 1.0.7)

# ---- group: Size of the Block
length = Panel("100")
width = Panel("21")
height = Panel("21")
box = CenterBox(Base=PlaneXY(0, 0, 0), X=expr("x/2", width), Y=expr("x/2", length), Z=expr("x/2", height))
geo = Geometry(box)

# ----
num = Number(height)

# ---- group: Distance
number_slider = Slider(75, range=0..1000)

# ---- group: Rotation
number_slider_2 = Slider(60, range=0..100)

# ----
xy = XYPlane(Origin=Point(0, 0, 0))
geo_2 = Geometry(geo)

srf = Surface(<surface referenced from the Rhino model>)
contour = Contour(Shape=srf, Point=Point(0, 0, 0), Direction=Vector(0, 0, 1), Distance=num)  # -> flatten(Contours)
dispatch = Dispatch(List=contour, DispatchPattern=[True, False])  # -> graft(ListA), graft(ListB)
divlength = DivideLength(Curve=dispatch.ListA, Length=number_slider)  # -> Points, Tangents, Parameters
divlength_2 = DivideLength(Curve=dispatch.ListB, Length=number_slider)  # -> Points, Tangents, Parameters
hframe = HorizontalFrame(Curve=dispatch.ListA, Parameter=divlength.Parameters)
hframe_2 = HorizontalFrame(Curve=dispatch.ListB, Parameter=divlength_2.Parameters)
neg = Negative(Value=number_slider_2)
prot = RotatePlane(Plane=hframe_2, Angle=degrees(neg))  # -> simplify(Plane)
prot_2 = RotatePlane(Plane=hframe, Angle=degrees(number_slider_2))  # -> simplify(Plane)
xy_2 = XYPlane(Origin=Point(0, 0, 0))
geo_3 = Geometry(geo)
orient = Orient(Geometry=geo_3, Source=xy_2, Target=prot_2)  # -> Geometry, Transform

merge = Merge(Data1=prot_2, Data2=prot)  # -> flatten(Result)
orient_2 = Orient(Geometry=geo_2, Source=xy, Target=prot)  # -> Geometry, Transform

merge_2 = Merge(Data1=orient.Geometry, Data2=orient_2.Geometry)  # -> flatten(Result)
lng = ListLength(List=merge_2)
panel = Panel(lng)
